# Grasshopper definition los_manantiales.gh (Grasshopper 1.0.8)

h_crown_m = Slider(5.84, range=2..9)
r_support_m = Slider(12, range=6..20)
h_tip_m = Slider(8.25, range=2..11)
glass_setback = Slider(0.75, range=0.4..1)
los_manantiales = Python3Script(
    x=h_crown_m,
    y=h_tip_m,
    z=r_support_m,
    w=glass_setback,
    rhinomcp_alias="shell",
    rhinomcp_graph_id="MCPGraph_20260730105242638")  # -> out, a, b, c
# ---------- los_manantiales: Python ----------
"""Los Manantiales restaurant - Felix Candela, Xochimilco, Mexico City, 1958.

An eight-sided groined vault made of four hyperbolic paraboloids sharing one
central crown. Each hypar carries its two adjacent groins as straight
generators, so a groin runs dead straight from the crown down to its ground
support. Cutting the hypar with the vertical planes through support and lobe
tip leaves the parabolic free edges - which makes one lobe exactly a
bi-quadratic Bezier patch, so no trimming is needed anywhere.

    x = crown height (m)      z = support radius (m)
    y = lobe tip height (m)   w = glazing setback (fraction of the footprint)

    a = shell    b = perimeter glazing    c = terrace slab
"""
import math
import Rhino.Geometry as rg

MM  = 1000.0                # document units are millimetres
TOL = 10.0

R_TIP   = 21.35 * MM        # 42.7 m across opposite lobe tips (documented)
h_crown = (5.84 if x is None else float(x)) * MM
h_tip   = (8.25 if y is None else float(y)) * MM
R_SUP   = (12.00 if z is None else float(z)) * MM
F_GLASS = 0.75 if w is None else float(w)

SQ2 = math.sqrt(2.0)
tau = R_TIP / SQ2           # lobe tip, measured along a generator
d   = R_SUP                 # ground support, measured along a generator
e   = tau - d
gam = (h_tip - h_crown + 2.0 * h_crown * tau / d) / (tau * tau)

# z(s,t) = h_crown - (h_crown/d)(s+t) + gam*s*t, with s and t running along the
# two groin directions.  s or t = 0 is a groin, so it stays straight; any other
# straight plan line cuts the hypar in a parabola.
def pt(s, t):
    return rg.Point3d((s - t) / SQ2, (s + t) / SQ2,
                      h_crown - h_crown * (s + t) / d + gam * s * t)

def quad(p0, p1, p2):
    c = rg.NurbsCurve(3, False, 3, 3)
    c.Points.SetPoint(0, p0)
    c.Points.SetPoint(1, p1)
    c.Points.SetPoint(2, p2)
    c.Knots[0] = 0.0
    c.Knots[1] = 0.0
    c.Knots[2] = 1.0
    c.Knots[3] = 1.0
    return c

def section(st0, st1):
    """The hypar over a straight plan segment - exactly a quadratic Bezier."""
    p0, p1 = pt(*st0), pt(*st1)
    m = pt(0.5 * (st0[0] + st1[0]), 0.5 * (st0[1] + st1[1]))
    ctrl = rg.Point3d(2.0 * m.X - 0.5 * (p0.X + p1.X),
                      2.0 * m.Y - 0.5 * (p0.Y + p1.Y),
                      2.0 * m.Z - 0.5 * (p0.Z + p1.Z))
    return quad(p0, ctrl, p1)

# --- the lobe patch: monomial coefficients of u^i v^j over the unit square,
# --- after the bilinear (u,v) -> (s,t) map of the kite crown/sup45/tip/sup135.
k = d / SQ2
CX = [[0.0, -k, 0.0], [k, 0.0, 0.0], [0.0, 0.0, 0.0]]
CY = [[0.0, k, 0.0], [k, e * SQ2, 0.0], [0.0, 0.0, 0.0]]
CZ = [[h_crown, -h_crown, 0.0],
      [-h_crown, gam * d * d - 2.0 * h_crown * e / d, gam * d * e],
      [0.0, gam * d * e, gam * e * e]]
TB = [[1.0, 0.0, 0.0], [1.0, 0.5, 0.0], [1.0, 1.0, 1.0]]   # monomial -> Bernstein

def bez(c):
    return [[sum(TB[i][a] * c[a][b] * TB[j][b]
                 for a in range(3) for b in range(3))
             for j in range(3)] for i in range(3)]

BX, BY, BZ = bez(CX), bez(CY), bez(CZ)
lobe = rg.NurbsSurface.Create(3, False, 3, 3, 3, 3)
for i in range(3):
    for j in range(3):
        lobe.Points.SetPoint(i, j, rg.Point3d(BX[i][j], BY[i][j], BZ[i][j]))
for kn in (lobe.KnotsU, lobe.KnotsV):
    kn[0] = 0.0
    kn[1] = 0.0
    kn[2] = 1.0
    kn[3] = 1.0

# --- glazing sits inside the footprint; the shell edge cantilevers past it
def wall(st0, st1):
    top = section(st0, st1)
    cps = [top.Points[i].Location for i in range(3)]
    bot = quad(*[rg.Point3d(p.X, p.Y, 0.0) for p in cps])
    return rg.NurbsSurface.CreateRuledSurface(bot, top)

f = F_GLASS
glass_runs = [((f * d, 0.0), (f * tau, f * tau)),
              ((0.0, f * d), (f * tau, f * tau))]

def merge(breps):
    out = rg.Brep()
    for b in breps:
        out.Append(b)
    return out

shell_srf, glass_srf = [], []
for i in range(4):
    xf = rg.Transform.Rotation(math.radians(90.0 * i),
                               rg.Vector3d.ZAxis, rg.Point3d.Origin)
    s = lobe.Duplicate()
    s.Transform(xf)
    shell_srf.append(s)
    for run in glass_runs:
        g = wall(*run)
        g.Transform(xf)
        glass_srf.append(g)

per = []
for i in range(4):
    aa = math.radians(45.0 + 90.0 * i)
    per.append(rg.Point3d(R_SUP * math.cos(aa), R_SUP * math.sin(aa), 0.0))
    bb = math.radians(90.0 + 90.0 * i)
    per.append(rg.Point3d(R_TIP * math.cos(bb), R_TIP * math.sin(bb), 0.0))
per.append(per[0])
slab = rg.Brep.CreatePlanarBreps([rg.PolylineCurve(per)], TOL)

faces = [rg.Brep.CreateFromSurface(s) for s in shell_srf]
joined = rg.Brep.JoinBreps(faces, TOL)

a = merge(list(joined) if joined else faces)
b = merge([rg.Brep.CreateFromSurface(s) for s in glass_srf])
c = merge(list(slab) if slab else [])

# --- checks: the groin must land exactly on the ground, and the patch boundary
# --- must agree with the independently derived parabola.
free = section((d, 0.0), (tau, tau))
dev = max(free.Points[i].Location.DistanceTo(
          rg.Point3d(BX[2][i], BY[2][i], BZ[2][i])) for i in range(3))
print("shell faces %d   glass faces %d   slab faces %d   closed %s"
      % (a.Faces.Count, b.Faces.Count, c.Faces.Count, a.IsSolid))
print("groin lands at z = %.6f mm      free-edge deviation = %.6f mm"
      % (pt(d, 0.0).Z, dev))
print("crown %.2f m   tip %.2f m   tip span %.2f m   support span %.2f m"
      % (h_crown / MM, h_tip / MM, 2 * R_TIP / MM, 2 * R_SUP / MM))
print("glass height: %.2f m at the lobe centre, %.2f m at the notch"
      % (pt(f * tau, f * tau).Z / MM, pt(f * d, 0.0).Z / MM))
# ---------- end los_manantiales ----------
